# Grasshopper definition KinergyMainInterface.gh (Grasshopper 1.0.7)
# plug-ins: Human UI

# ---- group: Oscillating + Translating / motion basics
separatorheight = Slider(4, range=0..10)
colour = ColourPicker(PickedColour=RGB(230, 230, 230))
separator = CreateSeparator(Thickness=0.5, Horizontal=True, Color=colour, Height=separatorheight)
width = Slider(110, range=0..1000)
height = Slider(35, range=0..1000)
label = CreateLabel(LabelText="Input action:", LabelSize=12, Justification=0)
adjustpos = AdjustElementPositioning(
    ElementsToAdjust=label,
    Margin="10,5,0,10",
    AbsolutePositioning=False,
    Width=width,
    Height=height,
    HorizontalAlignment=Slider(0, range=0..100))
height_2 = Slider(38, range=0..1000)
label_2 = CreateLabel(LabelText="Translating+Oscillating Basics", LabelSize=12, Justification=0)
width_2 = Slider(566, range=0..1000)
width_3 = Slider(110, range=0..1000)
height_3 = Slider(35, range=0..1000)
radiobtn = CreateRadioButton(RadioButtonName="Press/Compress", RadioButtonGroup="translation+oscillating input action", InitiallySelected=False)
adjustpos_2 = AdjustElementPositioning(
    ElementsToAdjust=label_2,
    Margin="10,5,0,10",
    AbsolutePositioning=False,
    Width=width_2,
    Height=height_2,
    HorizontalAlignment=Slider(0, range=0..100))
adjustpos_3 = AdjustElementPositioning(
    ElementsToAdjust=radiobtn,
    Margin="95,-55,0,10",
    AbsolutePositioning=False,
    Width=width_3,
    Height=height_3,
    HorizontalAlignment=Slider(0, range=0..100))
titlesize = Slider(20, range=0..30)
colour_2 = ColourPicker(PickedColour=RGB(51, 121, 200))
adjustelem = AdjustElementAppearance(ElementsToAdjust=label_2, Foreground=colour_2, FontSize=titlesize)
radiobtn_2 = CreateRadioButton(RadioButtonName="Twist/Turn", RadioButtonGroup="translation+oscillating input action", InitiallySelected=False)
height_4 = Slider(35, range=0..1000)
width_4 = Slider(115, range=0..1000)
adjustpos_4 = AdjustElementPositioning(
    ElementsToAdjust=radiobtn_2,
    Margin="225,-55,0,10",
    AbsolutePositioning=False,
    Width=width_4,
    Height=height_4,
    HorizontalAlignment=Slider(0, range=0..100))

# ----
panel = Panel("""Circle
Heart
Ecllipse""")
width_5 = Slider(300, range=0..1000)
height_5 = Slider(34, range=0..1000)
pulldown = CreatePulldownMenu(Label="Trajectory", ListItems=panel, showLabel=True)
adjustpos_5 = AdjustElementPositioning(
    ElementsToAdjust=pulldown,
    Margin="10,0,0,5",
    AbsolutePositioning=False,
    Width=width_5,
    Height=height_5,
    HorizontalAlignment=Slider(0, range=0..100))
values = ValueListener(Elements=radiobtn, SomeProperty=True)  # -> Values, Indices
values_2 = ValueListener(Elements=radiobtn_2, SomeProperty=True)  # -> Values, Indices
press = Panel(values.Values)
panel_2 = Panel(values_2.Values)

# ---- group: Reset Motion
width_6 = Slider(50, range=0..1000)
height_6 = Slider(30, range=0..1000)
button = CreateButton(ButtonName="Clear", ButtonStyle=0)
adjustpos_6 = AdjustElementPositioning(
    ElementsToAdjust=button,
    Margin="270,-45,0,10",
    AbsolutePositioning=False,
    Width=width_6,
    Height=height_6,
    HorizontalAlignment=Slider(0, range=0..100))
values_3 = ValueListener(Elements=button, SomeProperty=True)  # -> Values, Indices

# ---- group: Top Menu
number_slider = Slider(0, range=0..100)
width_7 = Slider(426, range=0..1000)
height_7 = Slider(35, range=0..1000)
width_8 = Slider(70, range=0..1000)
height_8 = Slider(35, range=0..1000)
width_9 = Slider(80, range=0..1000)
height_9 = Slider(35, range=0..1000)
width_10 = Slider(196, range=0..1000)
height_10 = Slider(35, range=0..1000)
radiobtn_3 = CreateRadioButton(RadioButtonName="Translating+Oscillating", RadioButtonGroup="motion type", InitiallySelected=False)
adjustpos_7 = AdjustElementPositioning(
    ElementsToAdjust=radiobtn_3,
    Margin="5,-10,0,10",
    AbsolutePositioning=False,
    Width=width_10,
    Height=height_10,
    HorizontalAlignment=Slider(0, range=0..100))
radiobtn_4 = CreateRadioButton(RadioButtonName="Oscillating", RadioButtonGroup="motion type", InitiallySelected=False)
adjustpos_8 = AdjustElementPositioning(
    ElementsToAdjust=radiobtn_4,
    Margin="180,-45,0,10",
    AbsolutePositioning=False,
    Width=width_9,
    Height=height_9,
    HorizontalAlignment=Slider(0, range=0..100))
radiobtn_5 = CreateRadioButton(RadioButtonName="Translating", RadioButtonGroup="motion type", InitiallySelected=False)
adjustpos_9 = AdjustElementPositioning(
    ElementsToAdjust=radiobtn_5,
    Margin="5,-10,0,10",
    AbsolutePositioning=False,
    Width=width_7,
    Height=height_7,
    HorizontalAlignment=number_slider)
radiobtn_6 = CreateRadioButton(RadioButtonName="Rotating", RadioButtonGroup="motion type", InitiallySelected=False)
adjustpos_10 = AdjustElementPositioning(
    ElementsToAdjust=radiobtn_6,
    Margin="100,-45,0,10",
    AbsolutePositioning=False,
    Width=width_8,
    Height=height_8,
    HorizontalAlignment=Slider(0, range=0..100))
label_3 = CreateLabel(LabelText="Select a target motion type:", LabelSize=12, Justification=0)
adjustpos_11 = AdjustElementPositioning(
    ElementsToAdjust=label_3,
    Margin="0,0,0,5",
    AbsolutePositioning=False,
    Width=width_7,
    Height=height_7,
    HorizontalAlignment=number_slider)

# ---- group: Translating / motion basics
separatorheight_2 = Slider(4, range=0..10)
colour_3 = ColourPicker(PickedColour=RGB(230, 230, 230))
width_11 = Slider(110, range=0..1000)
height_11 = Slider(35, range=0..1000)
separator_2 = CreateSeparator(Thickness=0.5, Horizontal=True, Color=colour_3, Height=separatorheight_2)
width_12 = Slider(110, range=0..1000)
height_12 = Slider(35, range=0..1000)
label_4 = CreateLabel(LabelText="Input action:", LabelSize=12, Justification=0)
label_5 = CreateLabel(LabelText="Output motion:", LabelSize=12, Justification=0)
adjustpos_12 = AdjustElementPositioning(
    ElementsToAdjust=label_5,
    Margin="10,-10,0,10",
    AbsolutePositioning=False,
    Width=width_11,
    Height=height_11,
    HorizontalAlignment=Slider(0, range=0..100))
adjustpos_13 = AdjustElementPositioning(
    ElementsToAdjust=label_4,
    Margin="10,5,0,10",
    AbsolutePositioning=False,
    Width=width_12,
    Height=height_12,
    HorizontalAlignment=Slider(0, range=0..100))
width_13 = Slider(110, range=0..1000)
height_13 = Slider(35, range=0..1000)
height_14 = Slider(38, range=0..1000)
label_6 = CreateLabel(LabelText="Translating Basics", LabelSize=12, Justification=0)
width_14 = Slider(566, range=0..1000)
width_15 = Slider(110, range=0..1000)
height_15 = Slider(35, range=0..1000)
radiobtn_7 = CreateRadioButton(RadioButtonName="Last for a while", RadioButtonGroup="translation output type", InitiallySelected=False)
values_4 = ValueListener(Elements=radiobtn_7, SomeProperty=True)  # -> Values, Indices
radiobtn_8 = CreateRadioButton(RadioButtonName="Press/Compress", RadioButtonGroup="translation input action", InitiallySelected=False)
values_5 = ValueListener(Elements=radiobtn_8, SomeProperty=True)  # -> Values, Indices
adjustpos_14 = AdjustElementPositioning(
    ElementsToAdjust=radiobtn_7,
    Margin="110,-55,0,10",
    AbsolutePositioning=False,
    Width=width_13,
    Height=height_13,
    HorizontalAlignment=Slider(0, range=0..100))
adjustpos_15 = AdjustElementPositioning(
    ElementsToAdjust=label_6,
    Margin="10,5,0,10",
    AbsolutePositioning=False,
    Width=width_14,
    Height=height_14,
    HorizontalAlignment=Slider(0, range=0..100))
adjustpos_16 = AdjustElementPositioning(
    ElementsToAdjust=radiobtn_8,
    Margin="95,-55,0,10",
    AbsolutePositioning=False,
    Width=width_15,
    Height=height_15,
    HorizontalAlignment=Slider(0, range=0..100))
width_16 = Slider(115, range=0..1000)
height_16 = Slider(35, range=0..1000)
titlesize_2 = Slider(20, range=0..30)
colour_4 = ColourPicker(PickedColour=RGB(51, 121, 200))
radiobtn_9 = CreateRadioButton(RadioButtonName="Instant", RadioButtonGroup="translation output type", InitiallySelected=False)
adjustpos_17 = AdjustElementPositioning(
    ElementsToAdjust=radiobtn_9,
    Margin="235,-55,0,10",
    AbsolutePositioning=False,
    Width=width_16,
    Height=height_16,
    HorizontalAlignment=Slider(0, range=0..100))
values_6 = ValueListener(Elements=radiobtn_9, SomeProperty=True)  # -> Values, Indices
adjustelem_2 = AdjustElementAppearance(ElementsToAdjust=label_6, Foreground=colour_4, FontSize=titlesize_2)
radiobtn_10 = CreateRadioButton(RadioButtonName="Twist/Turn", RadioButtonGroup="translation input action", InitiallySelected=False)
values_7 = ValueListener(Elements=radiobtn_10, SomeProperty=True)  # -> Values, Indices
python = GhPythonScript(x=values_5.Values, y=values_7.Values)  # -> a, b
# ---------- python: Python ----------
__author__ = "ediga"
__version__ = "2020.07.29"

import rhinoscriptsyntax as rs

if x and not y:
    a = False
    b = False
elif not x and y:
    a = False
    b = True
else:
    a = True
    b = True
# ---------- end python ----------
hideshow = HideShowElement(ElementToHideShow=radiobtn_7, Show=Toggle(True), Collapse=Toggle(False), Disable=python.a)
hideshow_2 = HideShowElement(ElementToHideShow=radiobtn_9, Show=Toggle(True), Collapse=Toggle(False), Disable=python.b)
height_17 = Slider(35, range=0..1000)
width_17 = Slider(115, range=0..1000)
adjustpos_18 = AdjustElementPositioning(
    ElementsToAdjust=radiobtn_10,
    Margin="225,-55,0,10",
    AbsolutePositioning=False,
    Width=width_17,
    Height=height_17,
    HorizontalAlignment=Slider(0, range=0..100))

# ---- group: Motion Selection Logic
values_8 = ValueListener(Elements=radiobtn_5, SomeProperty=True)  # -> Values, Indices
values_9 = ValueListener(Elements=radiobtn_6, SomeProperty=True)  # -> Values, Indices
values_10 = ValueListener(Elements=radiobtn_4, SomeProperty=True)  # -> Values, Indices
values_11 = ValueListener(Elements=radiobtn_3, SomeProperty=True)  # -> Values, Indices
rotating = Panel(values_9.Values)
translating = Panel(values_8.Values)
oscillating = Panel(values_10.Values)
translating_oscillating = Panel(values_11.Values)
python_2 = GhPythonScript(x=values_8.Values, y=values_9.Values, z=values_10.Values, u=values_11.Values)  # -> a, b, c, d, e
# ---------- python_2: Python ----------
#provides a scripting component.
#    Inputs:
#        x: Translation button listener
#        y: Rotation button listener
#        z: Oscillating button listener
#        u: Translation+oscillating button listener
#    Output:
#        a: Visibility indicator for the translation control panel
#        b: Visibility indicator for the rotation control panel
#        c: Visibility indicator for the oscillating control panel
#        d: Visibility indicator for the translation + oscillating control panel
#        e: Visibility indicator for the default control panel
#
#__author__ = "ediga"
#__version__ = "2020.07.28"

import rhinoscriptsyntax as rs


if x and not y and not z and not u:
    a = True
    b = False
    c = False
    d = False
    e = False
elif not x and y and not z and not u:
    a = False
    b = True
    c = False
    d = False
    e = False
elif not x and not y and z and not u:
    a = False
    b = False
    c = True
    d = False
    e = False
elif not x and not y and not z and u:
    a = False
    b = False
    c = False
    d = True
    e = False
else:
    a = False
    b = False
    c = False
    d = False
    e = True
# ---------- end python_2 ----------

# ---- group: Oscillating + Translating
colour_5 = ColourPicker(PickedColour=RGB(101, 168, 99))
width_18 = Slider(566, range=0..1000)
height_18 = Slider(38, range=0..1000)
titlesize_3 = Slider(20, range=0..30)
label_7 = CreateLabel(LabelText="Kinetic Unit for Trans+Oscillating", LabelSize=12, Justification=0)
strength = Slider(0.5, range=0..1)
repetition = Slider(10, range=0..20)
separatorheight_3 = Slider(10, range=0..10)
colour_6 = ColourPicker(PickedColour=RGB(230, 230, 230))
width_19 = Slider(400, range=0..1000)
adjustpos_19 = AdjustElementPositioning(
    ElementsToAdjust=label_7,
    Margin="10,5,0,20",
    AbsolutePositioning=False,
    Width=width_18,
    Height=height_18,
    HorizontalAlignment=Slider(0, range=0..100))
adjustelem_3 = AdjustElementAppearance(ElementsToAdjust=label_7, Foreground=colour_5, FontSize=titlesize_3)
width_20 = Slider(150, range=0..1000)
height_19 = Slider(30, range=0..1000)
width_21 = Slider(310, range=0..400)
height_20 = Slider(30, range=0..30)
width_22 = Slider(310, range=0..400)
height_21 = Slider(30, range=0..30)
slider = CreateSlider(Slider=strength, ShowBounds=False, ShowTicks=False, ShowTooltip=False, ShowValLabel=True, showLabel=True)
slider_2 = CreateSlider(Slider=repetition, ShowBounds=False, ShowTicks=False, ShowTooltip=False, ShowValLabel=True, showLabel=True)
separator_3 = CreateSeparator(Thickness=0.5, Horizontal=True, Color=colour_6, Width=width_19, Height=separatorheight_3)
separatorheight_4 = Slider(4, range=0..10)
panel_3 = Panel("""Uniform
Modified uniform
Uniform acceleration & deceleration""")
colour_7 = ColourPicker(PickedColour=RGB(230, 230, 230))
width_23 = Slider(400, range=0..1000)
true_button = CreateTrueOnlyButton(ButtonName="Select region of interest", ButtonStyle=0)
adjustpos_20 = AdjustElementPositioning(
    ElementsToAdjust=true_button,
    Margin="10,0,0,10",
    AbsolutePositioning=False,
    Width=width_20,
    Height=height_19,
    HorizontalAlignment=Slider(0, range=0..100))
adjustpos_21 = AdjustElementPositioning(
    ElementsToAdjust=slider,
    Margin="10,5,0,10",
    AbsolutePositioning=False,
    Width=width_21,
    Height=height_20,
    HorizontalAlignment=Slider(0, range=0..100))
adjustpos_22 = AdjustElementPositioning(
    ElementsToAdjust=slider_2,
    Margin="10,0,0,5",
    AbsolutePositioning=False,
    Width=width_22,
    Height=height_21,
    HorizontalAlignment=Slider(0, range=0..100))
width_24 = Slider(300, range=0..1000)
height_22 = Slider(34, range=0..1000)
checkbox = CreateCheckbox(Label="Add a lock", StartingValue=False)
width_25 = Slider(135, range=0..1000)
height_23 = Slider(30, range=0..1000)
width_26 = Slider(135, range=0..1000)
button_2 = CreateButton(ButtonName="Preview", ButtonStyle=0)
height_24 = Slider(30, range=0..1000)
width_27 = Slider(150, range=0..1000)
height_25 = Slider(30, range=0..1000)
separator_4 = CreateSeparator(Thickness=0.5, Horizontal=True, Color=colour_7, Width=width_23, Height=separatorheight_4)
width_28 = Slider(150, range=0..1000)
height_26 = Slider(30, range=0..1000)
width_29 = Slider(450, range=0..1000)
height_27 = Slider(35, range=0..1000)
pulldown_2 = CreatePulldownMenu(Label="Pattern", ListItems=panel_3, showLabel=True)
adjustpos_23 = AdjustElementPositioning(
    ElementsToAdjust=pulldown_2,
    Margin="10,0,0,10",
    AbsolutePositioning=False,
    Width=width_24,
    Height=height_22,
    HorizontalAlignment=Slider(0, range=0..100))
true_button_2 = CreateTrueOnlyButton(ButtonName="Select the input handler", ButtonStyle=0)
true_button_3 = CreateTrueOnlyButton(ButtonName="Select the end effector", ButtonStyle=0)
true_button_4 = CreateTrueOnlyButton(ButtonName="Set translating direction", ButtonStyle=0)
adjustpos_24 = AdjustElementPositioning(ElementsToAdjust=true_button_4, Margin="165,-40,0,10", AbsolutePositioning=False, Width=width_25, Height=height_23)
adjustpos_25 = AdjustElementPositioning(
    ElementsToAdjust=true_button_3,
    Margin="177,-40,0,15",
    AbsolutePositioning=False,
    Width=width_26,
    Height=height_24,
    HorizontalAlignment=Slider(0, range=0..100))
adjustpos_26 = AdjustElementPositioning(
    ElementsToAdjust=true_button_2,
    Margin="10,5,0,10",
    AbsolutePositioning=False,
    Width=width_27,
    Height=height_25,
    HorizontalAlignment=Slider(0, range=0..100))
adjustpos_27 = AdjustElementPositioning(
    ElementsToAdjust=button_2,
    Margin="165,-45,0,10",
    AbsolutePositioning=False,
    Width=width_28,
    Height=height_26,
    HorizontalAlignment=Slider(0, range=0..100))
adjustpos_28 = AdjustElementPositioning(ElementsToAdjust=checkbox, Margin="15,5,0,10", AbsolutePositioning=False, Width=width_29, Height=height_27)
hideshow_3 = HideShowElement(ElementToHideShow=pulldown_2, Show=Toggle(True), Collapse=Toggle(False), Disable=False)
hideshow_4 = HideShowElement(ElementToHideShow=true_button_3, Show=Toggle(True), Collapse=Toggle(False), Disable=False)
hideshow_5 = HideShowElement(ElementToHideShow=true_button_2, Show=Toggle(True), Collapse=Toggle(False), Disable=False)
merge = Merge(
    Data1=separator,
    Data2=label_2,
    Data3=label,
    Data4=radiobtn,
    Data5=radiobtn_2,
    Data9=separator_4,
    Data10=label_7,
    Data11=true_button,
    Data12=true_button_4,
    Data13=true_button_2,
    Data14=true_button_3,
    Data15=pulldown_2,
    Data16=slider,
    Data17=slider_2,
    Data18=pulldown,
    Data21=separator_3,
    Data22=checkbox,
    Data23=button_2)
stack = CreateStack(UIElements=merge, Horizontal=Toggle(False))
hideshow_6 = HideShowElement(ElementToHideShow=stack, Show=python_2.d, Collapse=Toggle(True), Disable=Toggle(False))

# ---- group: Translating
colour_8 = ColourPicker(PickedColour=RGB(101, 168, 99))
width_30 = Slider(566, range=0..1000)
height_28 = Slider(38, range=0..1000)
titlesize_4 = Slider(20, range=0..30)
label_8 = CreateLabel(LabelText="Kinetic Unit for Translating", LabelSize=12, Justification=0)
strength_2 = Slider(0.5, range=0..1)
displacement = Slider(10.187, range=0..20)
separatorheight_5 = Slider(10, range=0..10)
colour_9 = ColourPicker(PickedColour=RGB(230, 230, 230))
width_31 = Slider(400, range=0..1000)
adjustpos_29 = AdjustElementPositioning(
    ElementsToAdjust=label_8,
    Margin="10,5,0,20",
    AbsolutePositioning=False,
    Width=width_30,
    Height=height_28,
    HorizontalAlignment=Slider(0, range=0..100))
adjustelem_4 = AdjustElementAppearance(ElementsToAdjust=label_8, Foreground=colour_8, FontSize=titlesize_4)
width_32 = Slider(150, range=0..1000)
height_29 = Slider(30, range=0..1000)
width_33 = Slider(310, range=0..400)
height_30 = Slider(30, range=0..30)
width_34 = Slider(310, range=0..400)
height_31 = Slider(30, range=0..30)
slider_3 = CreateSlider(Slider=strength_2, ShowBounds=False, ShowTicks=False, ShowTooltip=False, ShowValLabel=True, showLabel=True)
slider_4 = CreateSlider(Slider=displacement, ShowBounds=False, ShowTicks=False, ShowTooltip=False, ShowValLabel=True, showLabel=True)
separator_5 = CreateSeparator(Thickness=0.5, Horizontal=True, Color=colour_9, Width=width_31, Height=separatorheight_5)
separatorheight_6 = Slider(4, range=0..10)
panel_4 = Panel("""Uniform
Modified uniform
Uniform acceleration & deceleration""")
colour_10 = ColourPicker(PickedColour=RGB(230, 230, 230))
width_35 = Slider(400, range=0..1000)
true_button_5 = CreateTrueOnlyButton(ButtonName="Select region of interest", ButtonStyle=0)
adjustpos_30 = AdjustElementPositioning(
    ElementsToAdjust=true_button_5,
    Margin="10,0,0,10",
    AbsolutePositioning=False,
    Width=width_32,
    Height=height_29,
    HorizontalAlignment=Slider(0, range=0..100))
adjustpos_31 = AdjustElementPositioning(
    ElementsToAdjust=slider_3,
    Margin="10,5,0,10",
    AbsolutePositioning=False,
    Width=width_33,
    Height=height_30,
    HorizontalAlignment=Slider(0, range=0..100))
adjustpos_32 = AdjustElementPositioning(
    ElementsToAdjust=slider_4,
    Margin="10,0,0,5",
    AbsolutePositioning=False,
    Width=width_34,
    Height=height_31,
    HorizontalAlignment=Slider(0, range=0..100))
width_36 = Slider(300, range=0..1000)
height_32 = Slider(34, range=0..1000)
checkbox_2 = CreateCheckbox(Label="Add a lock", StartingValue=False)
width_37 = Slider(135, range=0..1000)
height_33 = Slider(30, range=0..1000)
width_38 = Slider(135, range=0..1000)
height_34 = Slider(30, range=0..1000)
button_3 = CreateButton(ButtonName="Preview", ButtonStyle=0)
width_39 = Slider(150, range=0..1000)
height_35 = Slider(30, range=0..1000)
width_40 = Slider(150, range=0..1000)
separator_6 = CreateSeparator(Thickness=0.5, Horizontal=True, Color=colour_10, Width=width_35, Height=separatorheight_6)
height_36 = Slider(30, range=0..1000)
width_41 = Slider(450, range=0..1000)
height_37 = Slider(35, range=0..1000)
pulldown_3 = CreatePulldownMenu(Label="Pattern", ListItems=panel_4, showLabel=True)
adjustpos_33 = AdjustElementPositioning(
    ElementsToAdjust=pulldown_3,
    Margin="10,0,0,10",
    AbsolutePositioning=False,
    Width=width_36,
    Height=height_32,
    HorizontalAlignment=Slider(0, range=0..100))
true_button_6 = CreateTrueOnlyButton(ButtonName="Select the input handler", ButtonStyle=0)
true_button_7 = CreateTrueOnlyButton(ButtonName="Select the end effector", ButtonStyle=0)
true_button_8 = CreateTrueOnlyButton(ButtonName="Set translating direction", ButtonStyle=0)
adjustpos_34 = AdjustElementPositioning(ElementsToAdjust=true_button_8, Margin="165,-40,0,10", AbsolutePositioning=False, Width=width_37, Height=height_33)
adjustpos_35 = AdjustElementPositioning(
    ElementsToAdjust=true_button_7,
    Margin="177,-40,0,15",
    AbsolutePositioning=False,
    Width=width_38,
    Height=height_34,
    HorizontalAlignment=Slider(0, range=0..100))
adjustpos_36 = AdjustElementPositioning(
    ElementsToAdjust=true_button_6,
    Margin="10,5,0,10",
    AbsolutePositioning=False,
    Width=width_39,
    Height=height_35,
    HorizontalAlignment=Slider(0, range=0..100))
adjustpos_37 = AdjustElementPositioning(
    ElementsToAdjust=button_3,
    Margin="165,-45,0,10",
    AbsolutePositioning=False,
    Width=width_40,
    Height=height_36,
    HorizontalAlignment=Slider(0, range=0..100))
adjustpos_38 = AdjustElementPositioning(ElementsToAdjust=checkbox_2, Margin="15,5,0,10", AbsolutePositioning=False, Width=width_41, Height=height_37)
hideshow_7 = HideShowElement(ElementToHideShow=pulldown_3, Show=Toggle(True), Collapse=Toggle(False), Disable=values_6.Values)
hideshow_8 = HideShowElement(ElementToHideShow=true_button_7, Show=Toggle(True), Collapse=Toggle(False), Disable=values_6.Values)
hideshow_9 = HideShowElement(ElementToHideShow=true_button_6, Show=Toggle(True), Collapse=Toggle(False), Disable=values_6.Values)
merge_2 = Merge(
    Data1=separator_2,
    Data2=label_6,
    Data3=label_4,
    Data4=radiobtn_8,
    Data5=radiobtn_10,
    Data6=label_5,
    Data7=radiobtn_7,
    Data8=radiobtn_9,
    Data9=separator_6,
    Data10=label_8,
    Data11=true_button_5,
    Data12=true_button_8,
    Data13=true_button_6,
    Data14=true_button_7,
    Data15=pulldown_3,
    Data16=slider_3,
    Data17=slider_4,
    Data21=separator_5,
    Data22=checkbox_2,
    Data23=button_3)
stack_2 = CreateStack(UIElements=merge_2, Horizontal=Toggle(False))
hideshow_10 = HideShowElement(ElementToHideShow=stack_2, Show=python_2.a, Collapse=Toggle(True), Disable=Toggle(False))

# ---- group: Default Control Panel
width_42 = Slider(860, range=0..1000)
height_38 = Slider(35, range=0..1000)
colour_11 = ColourPicker(PickedColour=RGB(200, 200, 200))
label_9 = CreateLabel(LabelText="Please select the target motion...", LabelSize=12, Justification=0)
adjustpos_39 = AdjustElementPositioning(
    ElementsToAdjust=label_9,
    Margin="70,200,0,10",
    AbsolutePositioning=False,
    Width=width_42,
    Height=height_38,
    HorizontalAlignment=Slider(0, range=0..100))
stack_3 = CreateStack(UIElements=label_9, Horizontal=Toggle(False))
hideshow_11 = HideShowElement(ElementToHideShow=stack_3, Show=python_2.e, Collapse=Toggle(True), Disable=Toggle(False))
adjustelem_5 = AdjustElementAppearance(ElementsToAdjust=label_9, Foreground=colour_11)

# ----
panel_5 = Panel(python_2.b)
panel_6 = Panel(python_2.a)
panel_7 = Panel(python_2.c)
panel_8 = Panel(python_2.d)
panel_9 = Panel(python_2.e)
press_2 = Panel(values_5.Values)
twist = Panel(values_7.Values)
last_for_a_while = Panel(values_4.Values)
instant = Panel(values_6.Values)
folding_angle = Slider(10, range=0..120)
width_43 = Slider(310, range=0..400)
height_39 = Slider(30, range=0..30)
slider_5 = CreateSlider(Slider=folding_angle, ShowBounds=False, ShowTicks=False, ShowTooltip=False, ShowValLabel=True, showLabel=True)
adjustpos_40 = AdjustElementPositioning(
    ElementsToAdjust=slider_5,
    Margin="10,0,0,10",
    AbsolutePositioning=False,
    Width=width_43,
    Height=height_39,
    HorizontalAlignment=Slider(0, range=0..100))
toggle = BooleanToggle(False)
toggle_2 = BooleanToggle(True)

# ---- group: Oscillating / motion basics
separatorheight_7 = Slider(4, range=0..10)
colour_12 = ColourPicker(PickedColour=RGB(230, 230, 230))
separator_7 = CreateSeparator(Thickness=0.5, Horizontal=True, Color=colour_12, Height=separatorheight_7)
width_44 = Slider(110, range=0..1000)
height_40 = Slider(35, range=0..1000)
label_10 = CreateLabel(LabelText="Input action:", LabelSize=12, Justification=0)
adjustpos_41 = AdjustElementPositioning(
    ElementsToAdjust=label_10,
    Margin="10,5,0,10",
    AbsolutePositioning=False,
    Width=width_44,
    Height=height_40,
    HorizontalAlignment=Slider(0, range=0..100))
height_41 = Slider(38, range=0..1000)
label_11 = CreateLabel(LabelText="Oscillating Basics", LabelSize=12, Justification=0)
width_45 = Slider(566, range=0..1000)
width_46 = Slider(110, range=0..1000)
height_42 = Slider(35, range=0..1000)
radiobtn_11 = CreateRadioButton(RadioButtonName="Press/Compress", RadioButtonGroup="oscillating input action", InitiallySelected=False)
adjustpos_42 = AdjustElementPositioning(
    ElementsToAdjust=label_11,
    Margin="10,5,0,10",
    AbsolutePositioning=False,
    Width=width_45,
    Height=height_41,
    HorizontalAlignment=Slider(0, range=0..100))
adjustpos_43 = AdjustElementPositioning(
    ElementsToAdjust=radiobtn_11,
    Margin="95,-55,0,10",
    AbsolutePositioning=False,
    Width=width_46,
    Height=height_42,
    HorizontalAlignment=Slider(0, range=0..100))
titlesize_5 = Slider(20, range=0..30)
colour_13 = ColourPicker(PickedColour=RGB(51, 121, 200))
adjustelem_6 = AdjustElementAppearance(ElementsToAdjust=label_11, Foreground=colour_13, FontSize=titlesize_5)
radiobtn_12 = CreateRadioButton(RadioButtonName="Twist/Turn", RadioButtonGroup="oscillating input action", InitiallySelected=False)
height_43 = Slider(35, range=0..1000)
width_47 = Slider(115, range=0..1000)
adjustpos_44 = AdjustElementPositioning(
    ElementsToAdjust=radiobtn_12,
    Margin="225,-55,0,10",
    AbsolutePositioning=False,
    Width=width_47,
    Height=height_43,
    HorizontalAlignment=Slider(0, range=0..100))

# ----
amplitude = Slider(10, range=0..20)
width_48 = Slider(310, range=0..400)
height_44 = Slider(30, range=0..30)
slider_6 = CreateSlider(Slider=amplitude, ShowBounds=False, ShowTicks=False, ShowTooltip=False, ShowValLabel=True, showLabel=True)

# ---- group: Oscillating
colour_14 = ColourPicker(PickedColour=RGB(101, 168, 99))
width_49 = Slider(566, range=0..1000)
height_45 = Slider(38, range=0..1000)
titlesize_6 = Slider(20, range=0..30)
label_12 = CreateLabel(LabelText="Kinetic Unit for Oscillating", LabelSize=12, Justification=0)
strength_3 = Slider(0.5, range=0..1)
repetitions = Slider(10, range=0..20)
separatorheight_8 = Slider(10, range=0..10)
colour_15 = ColourPicker(PickedColour=RGB(230, 230, 230))
width_50 = Slider(400, range=0..1000)
adjustpos_45 = AdjustElementPositioning(
    ElementsToAdjust=label_12,
    Margin="10,5,0,20",
    AbsolutePositioning=False,
    Width=width_49,
    Height=height_45,
    HorizontalAlignment=Slider(0, range=0..100))
adjustelem_7 = AdjustElementAppearance(ElementsToAdjust=label_12, Foreground=colour_14, FontSize=titlesize_6)
width_51 = Slider(150, range=0..1000)
height_46 = Slider(30, range=0..1000)
width_52 = Slider(310, range=0..400)
height_47 = Slider(30, range=0..30)
width_53 = Slider(310, range=0..400)
height_48 = Slider(30, range=0..30)
slider_7 = CreateSlider(Slider=strength_3, ShowBounds=False, ShowTicks=False, ShowTooltip=False, ShowValLabel=True, showLabel=True)
slider_8 = CreateSlider(Slider=repetitions, ShowBounds=False, ShowTicks=False, ShowTooltip=False, ShowValLabel=True, showLabel=True)
separator_8 = CreateSeparator(Thickness=0.5, Horizontal=True, Color=colour_15, Width=width_50, Height=separatorheight_8)
separatorheight_9 = Slider(4, range=0..10)
panel_10 = Panel("""Uniform
Modified uniform
Uniform acceleration & deceleration""")
colour_16 = ColourPicker(PickedColour=RGB(230, 230, 230))
width_54 = Slider(400, range=0..1000)
true_button_9 = CreateTrueOnlyButton(ButtonName="Select region of interest", ButtonStyle=0)
adjustpos_46 = AdjustElementPositioning(
    ElementsToAdjust=true_button_9,
    Margin="10,0,0,10",
    AbsolutePositioning=False,
    Width=width_51,
    Height=height_46,
    HorizontalAlignment=Slider(0, range=0..100))
adjustpos_47 = AdjustElementPositioning(
    ElementsToAdjust=slider_7,
    Margin="10,5,0,10",
    AbsolutePositioning=False,
    Width=width_52,
    Height=height_47,
    HorizontalAlignment=Slider(0, range=0..100))
adjustpos_48 = AdjustElementPositioning(
    ElementsToAdjust=slider_8,
    Margin="10,0,0,5",
    AbsolutePositioning=False,
    Width=width_53,
    Height=height_48,
    HorizontalAlignment=Slider(0, range=0..100))
width_55 = Slider(300, range=0..1000)
height_49 = Slider(34, range=0..1000)
checkbox_3 = CreateCheckbox(Label="Add a lock", StartingValue=False)
width_56 = Slider(135, range=0..1000)
height_50 = Slider(30, range=0..1000)
width_57 = Slider(135, range=0..1000)
button_4 = CreateButton(ButtonName="Preview", ButtonStyle=0)
height_51 = Slider(30, range=0..1000)
width_58 = Slider(150, range=0..1000)
height_52 = Slider(30, range=0..1000)
width_59 = Slider(150, range=0..1000)
separator_9 = CreateSeparator(Thickness=0.5, Horizontal=True, Color=colour_16, Width=width_54, Height=separatorheight_9)
height_53 = Slider(30, range=0..1000)
width_60 = Slider(450, range=0..1000)
height_54 = Slider(35, range=0..1000)
pulldown_4 = CreatePulldownMenu(Label="Pattern", ListItems=panel_10, showLabel=True)
adjustpos_49 = AdjustElementPositioning(
    ElementsToAdjust=pulldown_4,
    Margin="10,0,0,10",
    AbsolutePositioning=False,
    Width=width_55,
    Height=height_49,
    HorizontalAlignment=Slider(0, range=0..100))
true_button_10 = CreateTrueOnlyButton(ButtonName="Select the input handler", ButtonStyle=0)
true_button_11 = CreateTrueOnlyButton(ButtonName="Select the end effector", ButtonStyle=0)
true_button_12 = CreateTrueOnlyButton(ButtonName="Set oscillating direction", ButtonStyle=0)
adjustpos_50 = AdjustElementPositioning(ElementsToAdjust=true_button_12, Margin="165,-40,0,10", AbsolutePositioning=False, Width=width_56, Height=height_50)
adjustpos_51 = AdjustElementPositioning(
    ElementsToAdjust=true_button_11,
    Margin="177,-40,0,15",
    AbsolutePositioning=False,
    Width=width_57,
    Height=height_51,
    HorizontalAlignment=Slider(0, range=0..100))
adjustpos_52 = AdjustElementPositioning(
    ElementsToAdjust=true_button_10,
    Margin="10,5,0,10",
    AbsolutePositioning=False,
    Width=width_58,
    Height=height_52,
    HorizontalAlignment=Slider(0, range=0..100))
adjustpos_53 = AdjustElementPositioning(
    ElementsToAdjust=button_4,
    Margin="165,-45,0,10",
    AbsolutePositioning=False,
    Width=width_59,
    Height=height_53,
    HorizontalAlignment=Slider(0, range=0..100))
adjustpos_54 = AdjustElementPositioning(ElementsToAdjust=checkbox_3, Margin="15,5,0,10", AbsolutePositioning=False, Width=width_60, Height=height_54)
hideshow_12 = HideShowElement(ElementToHideShow=pulldown_4, Show=Toggle(True), Collapse=Toggle(False), Disable=False)
hideshow_13 = HideShowElement(ElementToHideShow=true_button_11, Show=Toggle(True), Collapse=Toggle(False), Disable=False)
hideshow_14 = HideShowElement(ElementToHideShow=true_button_10, Show=Toggle(True), Collapse=Toggle(False), Disable=False)
merge_3 = Merge(
    Data1=separator_7,
    Data2=label_11,
    Data3=label_10,
    Data4=radiobtn_11,
    Data5=radiobtn_12,
    Data9=separator_9,
    Data10=label_12,
    Data11=true_button_9,
    Data12=true_button_12,
    Data13=true_button_10,
    Data14=true_button_11,
    Data15=pulldown_4,
    Data16=slider_7,
    Data17=slider_8,
    Data18=slider_6,
    Data21=separator_8,
    Data22=checkbox_3,
    Data23=button_4)
stack_4 = CreateStack(UIElements=merge_3, Horizontal=Toggle(False))
hideshow_15 = HideShowElement(ElementToHideShow=stack_4, Show=python_2.c, Collapse=Toggle(True), Disable=Toggle(False))

# ----
adjustpos_55 = AdjustElementPositioning(
    ElementsToAdjust=slider_6,
    Margin="10,0,0,5",
    AbsolutePositioning=False,
    Width=width_48,
    Height=height_44,
    HorizontalAlignment=Slider(0, range=0..100))
values_12 = ValueListener(Elements=radiobtn_11, SomeProperty=True)  # -> Values, Indices
radiobtn_13 = CreateRadioButton(RadioButtonName="Hinge pivot", RadioButtonGroup="rotating input action", InitiallySelected=False)
values_13 = ValueListener(Elements=radiobtn_13, SomeProperty=True)  # -> Values, Indices

# ---- group: Rotating / motion basics
separatorheight_10 = Slider(4, range=0..10)
colour_17 = ColourPicker(PickedColour=RGB(230, 230, 230))
width_61 = Slider(110, range=0..1000)
height_55 = Slider(35, range=0..1000)
separator_10 = CreateSeparator(Thickness=0.5, Horizontal=True, Color=colour_17, Height=separatorheight_10)
width_62 = Slider(110, range=0..1000)
height_56 = Slider(35, range=0..1000)
label_13 = CreateLabel(LabelText="Input action:", LabelSize=12, Justification=0)
label_14 = CreateLabel(LabelText="Output motion:", LabelSize=12, Justification=0)
adjustpos_56 = AdjustElementPositioning(
    ElementsToAdjust=label_14,
    Margin="10,-10,0,10",
    AbsolutePositioning=False,
    Width=width_61,
    Height=height_55,
    HorizontalAlignment=Slider(0, range=0..100))
adjustpos_57 = AdjustElementPositioning(
    ElementsToAdjust=label_13,
    Margin="10,5,0,10",
    AbsolutePositioning=False,
    Width=width_62,
    Height=height_56,
    HorizontalAlignment=Slider(0, range=0..100))
width_63 = Slider(110, range=0..1000)
height_57 = Slider(35, range=0..1000)
height_58 = Slider(38, range=0..1000)
label_15 = CreateLabel(LabelText="Rotating Basics", LabelSize=12, Justification=0)
width_64 = Slider(566, range=0..1000)
width_65 = Slider(110, range=0..1000)
height_59 = Slider(35, range=0..1000)
radiobtn_14 = CreateRadioButton(RadioButtonName="Instant", RadioButtonGroup="rotating output type", InitiallySelected=False)
values_14 = ValueListener(Elements=radiobtn_14, SomeProperty=True)  # -> Values, Indices
radiobtn_15 = CreateRadioButton(RadioButtonName="Twist", RadioButtonGroup="rotating input action", InitiallySelected=False)
values_15 = ValueListener(Elements=radiobtn_15, SomeProperty=True)  # -> Values, Indices
adjustpos_58 = AdjustElementPositioning(
    ElementsToAdjust=radiobtn_14,
    Margin="110,-55,0,10",
    AbsolutePositioning=False,
    Width=width_63,
    Height=height_57,
    HorizontalAlignment=Slider(0, range=0..100))
adjustpos_59 = AdjustElementPositioning(
    ElementsToAdjust=label_15,
    Margin="10,5,0,10",
    AbsolutePositioning=False,
    Width=width_64,
    Height=height_58,
    HorizontalAlignment=Slider(0, range=0..100))
adjustpos_60 = AdjustElementPositioning(
    ElementsToAdjust=radiobtn_15,
    Margin="95,-55,0,10",
    AbsolutePositioning=False,
    Width=width_65,
    Height=height_59,
    HorizontalAlignment=Slider(0, range=0..100))
width_66 = Slider(115, range=0..1000)
height_60 = Slider(35, range=0..1000)
titlesize_7 = Slider(20, range=0..30)
colour_18 = ColourPicker(PickedColour=RGB(51, 121, 200))
radiobtn_16 = CreateRadioButton(RadioButtonName="Last for a while", RadioButtonGroup="rotating output type", InitiallySelected=False)
values_16 = ValueListener(Elements=radiobtn_16, SomeProperty=True)  # -> Values, Indices
adjustpos_61 = AdjustElementPositioning(
    ElementsToAdjust=radiobtn_16,
    Margin="185,-55,0,10",
    AbsolutePositioning=False,
    Width=width_66,
    Height=height_60,
    HorizontalAlignment=Slider(0, range=0..100))
adjustelem_8 = AdjustElementAppearance(ElementsToAdjust=label_15, Foreground=colour_18, FontSize=titlesize_7)
radiobtn_17 = CreateRadioButton(RadioButtonName="Press", RadioButtonGroup="rotating input action", InitiallySelected=False)
values_17 = ValueListener(Elements=radiobtn_17, SomeProperty=True)  # -> Values, Indices
height_61 = Slider(35, range=0..1000)
width_67 = Slider(115, range=0..1000)
python_3 = GhPythonScript(x=values_15.Values, y=values_17.Values, z=values_13.Values)  # -> a, b, c, d, e
# ---------- python_3: Python ----------
"""Provides a scripting component.
    Inputs:
        x: twist
        y: press
        z: hinge folding
    Output:
        a: instant
        b: last for a while
        c: button 1 label
        d: button 2 label
        e: visibility of the last two buttons"""

__author__ = "ediga"
__version__ = "2020.07.29"

import rhinoscriptsyntax as rs

if x and not y and not z:
    a = False
    b = False
    c = "Select region of interest"
    d = "Set rotatory axis position"
    e = False
elif not x and y and not z:
    a = True
    b = False
    c = "Select region of interest"
    d = "Set rotatory axis position"
    e = False
elif not x and not y and z:
    a = False
    b = True
    c = "Select two parts of interest"
    d = "Set the hinge position"
    e = True
else:
    a = True
    b = True
    c = "Select region of interest"
    d = "Set rotatory axis position"
    e = False
# ---------- end python_3 ----------
hideshow_16 = HideShowElement(ElementToHideShow=radiobtn_14, Show=Toggle(True), Collapse=Toggle(False), Disable=python_3.a)
hideshow_17 = HideShowElement(ElementToHideShow=radiobtn_16, Show=Toggle(True), Collapse=Toggle(False), Disable=python_3.b)
adjustpos_62 = AdjustElementPositioning(
    ElementsToAdjust=radiobtn_17,
    Margin="160,-55,0,10",
    AbsolutePositioning=False,
    Width=width_67,
    Height=height_61,
    HorizontalAlignment=Slider(0, range=0..100))

# ---- group: Rotating
colour_19 = ColourPicker(PickedColour=RGB(101, 168, 99))
circle_rounds = Slider(10, range=0..20)
width_68 = Slider(566, range=0..1000)
height_62 = Slider(38, range=0..1000)
titlesize_8 = Slider(20, range=0..30)
label_16 = CreateLabel(LabelText="Kinetic Unit for Rotating", LabelSize=12, Justification=0)
strength_4 = Slider(0.5, range=0..1)
separatorheight_11 = Slider(10, range=0..10)
colour_20 = ColourPicker(PickedColour=RGB(230, 230, 230))
width_69 = Slider(400, range=0..1000)
adjustpos_63 = AdjustElementPositioning(
    ElementsToAdjust=label_16,
    Margin="10,5,0,20",
    AbsolutePositioning=False,
    Width=width_68,
    Height=height_62,
    HorizontalAlignment=Slider(0, range=0..100))
adjustelem_9 = AdjustElementAppearance(ElementsToAdjust=label_16, Foreground=colour_19, FontSize=titlesize_8)
slider_9 = CreateSlider(Slider=circle_rounds, ShowBounds=False, ShowTicks=False, ShowTooltip=False, ShowValLabel=True, showLabel=True)
panel_11 = Panel(python_3.c)
width_70 = Slider(150, range=0..1000)
height_63 = Slider(30, range=0..1000)
width_71 = Slider(310, range=0..400)
height_64 = Slider(30, range=0..30)
width_72 = Slider(310, range=0..400)
height_65 = Slider(30, range=0..30)
slider_10 = CreateSlider(Slider=strength_4, ShowBounds=False, ShowTicks=False, ShowTooltip=False, ShowValLabel=True, showLabel=True)
separator_11 = CreateSeparator(Thickness=0.5, Horizontal=True, Color=colour_20, Width=width_69, Height=separatorheight_11)
separatorheight_12 = Slider(4, range=0..10)
colour_21 = ColourPicker(PickedColour=RGB(230, 230, 230))
width_73 = Slider(400, range=0..1000)
true_button_13 = CreateTrueOnlyButton(ButtonName=panel_11, ButtonStyle=0)
adjustpos_64 = AdjustElementPositioning(
    ElementsToAdjust=true_button_13,
    Margin="10,0,0,10",
    AbsolutePositioning=False,
    Width=width_70,
    Height=height_63,
    HorizontalAlignment=Slider(0, range=0..100))
adjustpos_65 = AdjustElementPositioning(
    ElementsToAdjust=slider_10,
    Margin="10,20,0,10",
    AbsolutePositioning=False,
    Width=width_71,
    Height=height_64,
    HorizontalAlignment=Slider(0, range=0..100))
adjustpos_66 = AdjustElementPositioning(
    ElementsToAdjust=slider_9,
    Margin="10,0,0,10",
    AbsolutePositioning=False,
    Width=width_72,
    Height=height_65,
    HorizontalAlignment=Slider(0, range=0..100))
checkbox_4 = CreateCheckbox(Label="Add a lock", StartingValue=False)
panel_12 = Panel(python_3.d)
width_74 = Slider(140, range=0..1000)
height_66 = Slider(30, range=0..1000)
width_75 = Slider(140, range=0..1000)
button_5 = CreateButton(ButtonName="Preview", ButtonStyle=0)
height_67 = Slider(30, range=0..1000)
width_76 = Slider(150, range=0..1000)
height_68 = Slider(30, range=0..1000)
width_77 = Slider(150, range=0..1000)
separator_12 = CreateSeparator(Thickness=0.5, Horizontal=True, Color=colour_21, Width=width_73, Height=separatorheight_12)
height_69 = Slider(30, range=0..1000)
width_78 = Slider(450, range=0..1000)
height_70 = Slider(35, range=0..1000)
true_button_14 = CreateTrueOnlyButton(ButtonName="Select the input handler", ButtonStyle=0)
true_button_15 = CreateTrueOnlyButton(ButtonName="Select the end effector", ButtonStyle=0)
true_button_16 = CreateTrueOnlyButton(ButtonName=panel_12, ButtonStyle=0)
adjustpos_67 = AdjustElementPositioning(
    ElementsToAdjust=true_button_16,
    Margin="175,-40,0,10",
    AbsolutePositioning=False,
    Width=width_74,
    Height=height_66,
    HorizontalAlignment=Slider(0, range=0..100))
adjustpos_68 = AdjustElementPositioning(
    ElementsToAdjust=true_button_15,
    Margin="175,-40,0,15",
    AbsolutePositioning=False,
    Width=width_75,
    Height=height_67,
    HorizontalAlignment=Slider(0, range=0..100))
adjustpos_69 = AdjustElementPositioning(
    ElementsToAdjust=true_button_14,
    Margin="10,5,0,10",
    AbsolutePositioning=False,
    Width=width_76,
    Height=height_68,
    HorizontalAlignment=Slider(0, range=0..100))
adjustpos_70 = AdjustElementPositioning(
    ElementsToAdjust=button_5,
    Margin="165,-45,0,10",
    AbsolutePositioning=False,
    Width=width_77,
    Height=height_69,
    HorizontalAlignment=Slider(0, range=0..100))
adjustpos_71 = AdjustElementPositioning(ElementsToAdjust=checkbox_4, Margin="15,5,0,10", AbsolutePositioning=False, Width=width_78, Height=height_70)
hideshow_18 = HideShowElement(ElementToHideShow=true_button_15, Show=Toggle(True), Collapse=Toggle(False), Disable=values_14.Values)
merge_4 = Merge(
    Data1=separator_10,
    Data2=label_15,
    Data3=label_13,
    Data4=radiobtn_15,
    Data5=radiobtn_17,
    Data6=radiobtn_13,
    Data7=label_14,
    Data8=radiobtn_14,
    Data9=radiobtn_16,
    Data10=separator_12,
    Data11=label_16,
    Data12=true_button_13,
    Data13=true_button_16,
    Data14=true_button_14,
    Data15=true_button_15,
    Data16=slider_10,
    Data17=slider_9,
    Data18=slider_5,
    Data19=separator_11,
    Data20=checkbox_4,
    Data21=button_5)
hideshow_19 = HideShowElement(ElementToHideShow=true_button_14, Show=Toggle(True), Collapse=Toggle(False), Disable=values_14.Values)
stack_5 = CreateStack(UIElements=merge_4, Horizontal=Toggle(False))
hideshow_20 = HideShowElement(ElementToHideShow=stack_5, Show=python_2.b, Collapse=Toggle(True), Disable=Toggle(False))

# ---- group: MAIN WINDOW
merge_5 = Merge(
    Data1=label_3,
    Data2=radiobtn_5,
    Data3=radiobtn_6,
    Data4=radiobtn_4,
    Data5=radiobtn_3,
    Data6=button,
    Data7=stack_3,
    Data8=stack_2,
    Data9=stack_5,
    Data10=stack_4,
    Data11=stack)
launchwin = LaunchWindow(
    Show=Toggle(True),
    Name="Kinergy Design Tool",
    Width=Slider(345, range=0..1000),
    Height=Slider(650, range=0..1000),
    ChildStatus=0,
    EnableHorizScroll=False)
addelems = AddElements(Window=launchwin, Elements=flatten(merge_5), DoVLChecking=True)  # -> AddedElements, ElementNames

# ----
and = GateAnd(A=values_13.Values, B=values_14.Values)
hideshow_21 = HideShowElement(ElementToHideShow=slider_5, Show=and, Collapse=toggle_2, Disable=toggle)
not = GateNot(A=and)
hideshow_22 = HideShowElement(ElementToHideShow=slider_9, Show=not, Collapse=toggle_2, Disable=toggle)
last_for_a_while_2 = Panel(values_16.Values)
instant_2 = Panel(values_14.Values)
twist_2 = Panel(values_15.Values)
height_71 = Slider(35, range=0..1000)
width_79 = Slider(115, range=0..1000)
hinge_pivot = Panel(values_13.Values)
press_3 = Panel(values_17.Values)
values_18 = ValueListener(Elements=radiobtn_12, SomeProperty=True)  # -> Values, Indices
adjustpos_72 = AdjustElementPositioning(
    ElementsToAdjust=radiobtn_13,
    Margin="225,-55,0,10",
    AbsolutePositioning=False,
    Width=width_79,
    Height=height_71,
    HorizontalAlignment=Slider(0, range=0..100))
twist_3 = Panel(values_18.Values)
press_4 = Panel(values_12.Values)
